# Grasshopper definition ColorDisplay.gh (Grasshopper 0.9.76)
# plug-ins: Python Interpreter

blue_points = FilePath("C:\Users\mkell\Documents\HMV-CakeCity\blue _Contours.data")
red_points = FilePath("C:\Users\mkell\Documents\HMV-CakeCity\red _Contours.data")
green_points = FilePath("C:\Users\mkell\Documents\HMV-CakeCity\green _Contours.data")
read_file = ReadFile(File=red_points, PerLineParse=True)
file = ReadFile(File=blue_points, PerLineParse=True)
file_2 = ReadFile(File=green_points, PerLineParse=True)
panel = Panel(read_file)
panel_2 = Panel(file)
panel_3 = Panel(file_2)
pt = Point(panel_2)
pt_2 = Point(panel_3)
python = PythonScript(Contours=panel)  # -> Newcontours; inputs Contours: list
# ---------- python: Python ----------
contourTree = []
newContour = []
for cnt in Contours:
    if (cnt.startswith("NEW")):
        contourTree.append(newContour)
        newContour = []
    else:
        newContour.append(cnt)
Newcontours = contourTree
# ---------- end python ----------
pline = PolyLine(Vertices=pt, Closed=False)
pline_2 = PolyLine(Vertices=pt_2, Closed=False)
pt_3 = Point(python)
pline_3 = PolyLine(Vertices=pt_3, Closed=False)
green_lines_smooth = SmoothPolyline(Polyline=pline_2, Strength=Slider(1, range=0..1), Times=Slider(4, range=0..10))
red_lines_smooth = SmoothPolyline(Polyline=pline_3, Strength=Slider(1, range=0..1), Times=Slider(4, range=0..10))
blue_lines_smooth = SmoothPolyline(Polyline=pline, Strength=Slider(1, range=0..1), Times=Slider(4, range=0..10))
